# Dynamo graph AdaClearances-TurningRadius.dyn (Dynamo 2.16.2.5624)
# packages: bimorphNodes 5.1.3, Clockwork for Dynamo 2.x 2.6.0

# note: Turnout Time Calculator

# group: PROCESSES
# note: These groups of nodes will represent actions such as retrieve information, perform intersections, create lists, flatten lists, etc.

# group: INPUTS
# note: These groups of nodes will represent information that should be manually or automatically added in order to run the algorithm

# group: DYNAMO GEOMETRIES
# note: These groups will contain nodes that generate geometries to be interpreted by Dynamo

# group: OUTPUTS
# note: These groups will include nodes that will show the results generated. These outputs will be also shown in Dynamo Player

# group: INSTRUCTIONS
# note: These nodes will indicate important instruction to adjust elements in the Dynamo Scripts

# group: VASA NODES
# note: This color indicates nodes that deal with the voxelization of the model

# group: Selects family type
# note: Information:
# Date: Jun-2024
# Developed By: Ingrid Freire
# as a part of her Master's dissertation
# European Master in Building Information Modelling
# Universidade do Minho
family_types = FamilyTypes("22_ADA FLOOR MOUNTED WC:Accessible (604.9.2.1)")  # graph input

# group: Filters elements by family type
byFamilyType = FamilyInstance.ByFamilyType(familyType=family_types)
count = List.Count(list=byFamilyType)
watch = Watch(count)
all_elements_of_family_type = ElementsOfFamilyType(Family_Type=family_types)
getHost = FamilyInstance.GetHost(familyInstance=all_elements_of_family_type)
geometry = Element.Geometry(element=getHost)

# group: Selects elements for intersection
categories = Categories("OST_Walls")
categories_2 = Categories("OST_Furniture")
categories_3 = Categories("OST_Casework")
categories_4 = Categories("OST_Doors")
list_create = List.Create(item0=categories, item1=categories_2, item2=categories_3, item3=categories_4)
all_elements_of_category = ElementsOfCategory(Category=list_create)
flatten = List.Flatten(list=all_elements_of_category)

# group: View to create details lines
select_view_to_create_the_detail = Views("ZZ - DESIGN CHECK")  # "Select view to create the detail lines. They should be in the end of the list (default: ZZ-DESIGN CHECK)"; graph input

# group: Gets wall width to move rectangle
elementType = Element.ElementType(element=getHost)
string = StringInput("Width")
getParameterValueByName = Element.GetParameterValueByName(element=elementType, parameterName=string)
code_block = CodeBlock(x=getParameterValueByName) { x/2+2.5; }

# group: Gets coordinates and create vector following facing orientation
get_cs = Python(IN[0]=all_elements_of_family_type)  # CPython3
# ---------- get_cs.python (21 lines) ----------
import sys
import clr
clr.AddReference('ProtoGeometry')
from Autodesk.DesignScript.Geometry import *

items = UnwrapElement(IN[0]) #IN[0] 
geoms = []

for item in items:
	tr = item.GetTransform()
	originft = Vector.ByCoordinates( tr.Origin.X, tr.Origin.Y, tr.Origin.Z)
	origin = Vector.AsPoint (Vector.Scale(originft, 1))
	x = Vector.ByCoordinates( tr.BasisX.X, tr.BasisX.Y, tr.BasisX.Z)
	y = Vector.ByCoordinates( tr.BasisY.X, tr.BasisY.Y, tr.BasisY.Z)
	z =	Vector.ByCoordinates( tr.BasisZ.X, tr.BasisZ.Y, tr.BasisZ.Z)

	geo = CoordinateSystem.ByOriginVectors(origin, x, y, z)
	geoms.append(geo)

# Assign your output to the OUT variable.
OUT = geoms
# ----------------------------------------
origin = CoordinateSystem.Origin(coordinateSystem=get_cs)
facingOrientation = FamilyInstance.FacingOrientation(familyInstance=all_elements_of_family_type)
number = DoubleInput(4.3)
byStartPointDirectionLength = Line.ByStartPointDirectionLength(startPoint=origin, direction=facingOrientation, length=number)
byStartPointDirectionLength_2 = Line.ByStartPointDirectionLength(startPoint=origin, direction=facingOrientation, length=code_block)

# group: Creates cylinder on endpoint of curves. move cylinder in the z axis
endPoint = Curve.EndPoint(curve=byStartPointDirectionLength)
number_2 = DoubleInput(5)
translate = Geometry.Translate(geometry=endPoint, zTranslation=number_2)
number_3 = DoubleInput(2.5)
byPointsRadius = Cylinder.ByPointsRadius(startPoint=endPoint, endPoint=translate, radius=number_3)
byCenterPointRadius = Circle.ByCenterPointRadius(centerPoint=endPoint, radius=number_3)

# group: Runs clash detection
intersectsSolid = Revit.Element.IntersectsSolid(solids=byPointsRadius, elements=flatten)

# group: Gets results and clean lists
intersectingElements = Results.SolidIntersectionResult.IntersectingElements(solidIntersectionResult=intersectsSolid)
flatten_2 = List.Flatten(list=intersectingElements)
clean = List.Clean(list=flatten_2)
geometry_2 = Element.Geometry(element=clean)

# group: Creates detail line
byCurve = Custom[DetailCurve.ByCurve+](curve=byCenterPointRadius, view=select_view_to_create_the_detail)  # package Clockwork for Dynamo 2.x; Creates a detail line based on a given curve. Unlike the OOTB node it can also draw circles.

# group: Counts number of toilets to review - Turning Radius
isEmpty = List.IsEmpty(list=intersectingElements@@L2)
filterByBoolMask = List.FilterByBoolMask(list=byCurve, mask=isEmpty)
count_2 = List.Count(list=filterByBoolMask.out)
number_of_toilets_to_review = Watch(count_2)  # "Number of toilets to review Turning Radius Clearance"; graph output

handOrientation = Custom[FamilyInstance.HandOrientation](familyInstance=all_elements_of_family_type)  # package Clockwork for Dynamo 2.x; Gets the hand orientation of a hosted object (e.g. a window or a door)

# group: cuboid dimensions
code_block_2 = CodeBlock { 5; 5; 8; }
code_block_3 = CodeBlock(width=code_block_2.out0, length=code_block_2.out1, height=code_block_2.out2) { width; length; height; }

# group: Creates cuboid on endpoint of curves. move cuboid in the z axis
endPoint_2 = Curve.EndPoint(curve=byStartPointDirectionLength_2)
number_4 = DoubleInput(3.2)
byLengths = Cuboid.ByLengths(origin=endPoint_2, width=code_block_3.width, length=code_block_3.length, height=code_block_3.height)

byOriginVectors = CoordinateSystem.ByOriginVectors(origin=endPoint_2, xAxis=facingOrientation, yAxis=handOrientation)
byLengths_2 = Cuboid.ByLengths(coordinateSystem=byOriginVectors, width=code_block_3.width, length=code_block_3.length, height=code_block_3.height)

# group (continued): Creates cuboid on endpoint of curves. move cuboid in the z axis
translate_2 = Geometry.Translate(geometry=byLengths_2, zTranslation=number_4)

number_5 = DoubleInput(0.328)
translate_3 = Geometry.Translate(geometry=translate_2, direction=handOrientation, distance=number_5)

# group: Filters surfaces by horizontal down to create rectangle in floor plan
bySolid = PolySurface.BySolid(solid=translate_3)
surfaces = PolySurface.Surfaces(polySurface=bySolid)
filterByOrientation = Custom[Surface.FilterByOrientation](surfaces=surfaces)  # package Clockwork for Dynamo 2.x; Sorts surfaces in three lists based on their orientation (vertical, horizontal up & horizontal down) and also returns three corresponding lists of booleans.
list_create_2 = List.Create(item0=filterByOrientation.horizontalDown)
perimeterCurves = Surface.PerimeterCurves(surface=list_create_2)
watch_3d = Watch3D(filterByOrientation.horizontalDown)

code_block_4 = CodeBlock { 2; }
flatten_3 = List.Flatten(list=perimeterCurves, amount=code_block_4)

# group: Creates detail line
byCurve_2 = Custom[DetailCurve.ByCurve+](curve=flatten_3, view=select_view_to_create_the_detail)

# group: Runs clash detection with cuboids
intersectsSolid_2 = Revit.Element.IntersectsSolid(solids=translate_3, elements=flatten)

# group: Gets results and clean lists
intersectingElements_2 = Results.SolidIntersectionResult.IntersectingElements(solidIntersectionResult=intersectsSolid_2)
flatten_4 = List.Flatten(list=intersectingElements_2)
clean_2 = List.Clean(list=flatten_4)
geometry_3 = Element.Geometry(element=clean_2)

# group: Counts number of toilets to review - 60" x 60" clearance
isEmpty_2 = List.IsEmpty(list=intersectingElements_2@@L2)
filterByBoolMask_2 = List.FilterByBoolMask(list=byCurve_2, mask=isEmpty_2)
count_3 = List.Count(list=filterByBoolMask_2.out)
number_of_toilets_to_review_60_x = Watch(count_3)  # "Number of toilets to review 60" x 60" clearance"; graph output

list_create_3 = List.Create(item0=filterByBoolMask.out, item1=filterByBoolMask_2.out)

# group: Override toilets graphic in active view
code_block_5 = CodeBlock { 0; 255; }
byARGB = Color.ByARGB(alpha=code_block_5.out0, red=code_block_5.out1, green=code_block_5.out0, blue=code_block_5.out0)
byProperties = Revit.Filter.OverrideGraphicSettings.ByProperties(cutFillColor=byARGB, projectionFillColor=byARGB, cutLineColor=byARGB, projectionLineColor=byARGB)
overrideInView = Element.OverrideInView(element=list_create_3, overrides=byProperties)
isEmpty_3 = List.IsEmpty(list=intersectingElements@@L2)  # frozen
filterByBoolMask_3 = List.FilterByBoolMask(list=all_elements_of_family_type, mask=isEmpty_3)

dot = Vector.Dot()  # unwired: vector, vec
reverse = Vector.Reverse(vector=handOrientation)
