# Dynamo graph DoorClearance.dyn (Dynamo 2.16.2.5624)
# packages: bimorphNodes 5.1.3, Clockwork for Dynamo 2.x 2.6.0, archi-lab.net 2024.217.1024

# group: INPUTS
# note: These groups of nodes will represent information that should be manually or automatically added in order to run the algorithm

# group: DYNAMO GEOMETRIES
# note: These groups will contain nodes that generate geometries to be interpreted by Dynamo

# group: PROCESSES
# note: These groups of nodes will represent actions such as retrieve information, perform intersections, create lists, flatten lists, etc.

# group: OUTPUTS
# note: These groups will include nodes that will show the results generated. These outputs will be also shown in Dynamo Player

# group: INSTRUCTIONS
# note: These nodes will indicate important instruction to adjust elements in the Dynamo Scripts

# group: Selects model elements and the level
# note: Door Clearance Checking
# note: Information:
# Date: Jun-2024
# Developed By: Ingrid Freire
# as a part of her Master's dissertation
# European Master in Building Information Modelling
# Universidade do Minho
select_model_elements = DSModelElementsSelection()  # 5 picked in the model; graph input
select_level_to_run_checking = Levels("MAIN LEVEL")  # graph input

# group: Filters by type and levels
elementType = Element.ElementType(element=select_model_elements)
all_elements_of_family_type = ElementsOfFamilyType(Family_Type=elementType)
flatten = List.Flatten(list=all_elements_of_family_type)
string = StringInput("Level")
getParameterValueByName = Element.GetParameterValueByName(element=flatten, parameterName=string)
string_from_object = FromObject(object=getParameterValueByName)
string_from_object_2 = FromObject(object=select_level_to_run_checking)
contains = String.Contains(string=string_from_object, searchFor=string_from_object_2)
filterByBoolMask = List.FilterByBoolMask(list=flatten, mask=contains)

# group: Retrieve element types
flatten_2 = List.Flatten(list=filterByBoolMask.in)
uniqueItems = List.UniqueItems(list=flatten_2)
elementType_2 = Element.ElementType(element=uniqueItems)

# group: Filter #1: Filter elements by function (Interior)
code_block = CodeBlock { "Function"; "0"; }
getParameterValueByName_2 = Element.GetParameterValueByName(element=elementType_2, parameterName=code_block.out0)
string_from_object_3 = FromObject(object=getParameterValueByName_2)
eq = string_from_object_3 == code_block.out1
final_list_of_doors = List.FilterByBoolMask(list=uniqueItems, mask=eq)
getHost = FamilyInstance.GetHost(familyInstance=final_list_of_doors.in)
count = List.Count(list=final_list_of_doors.in)
number_of_checked_doors = Watch(count)  # graph output

# group: Creates geometry
geometry = Element.Geometry(element=getHost)

# group: Gets doors width
elementType_3 = Element.ElementType(element=final_list_of_doors.in)
string_2 = StringInput("Width")
getParameterValueByName_3 = Element.GetParameterValueByName(element=elementType_3, parameterName=string_2)

# group: Adds value for null results of door width
code_block_2 = CodeBlock { 0; }
code_block_3 = CodeBlock(x=getParameterValueByName_3, y=code_block_2) { x>=y; }
string_3 = StringInput("false")
replaceNull = archilab.Lists.Lists.ReplaceNull(list=code_block_3, replacement=string_3)
string_from_object_4 = FromObject(object=replaceNull)
eq_2 = string_from_object_4 == string_3
code_block_4 = CodeBlock { 0; }
code_block_5 = CodeBlock { 1; }
if_ = RefactoredIf(test=eq_2, true=code_block_4, false=code_block_5)
gt = _ > code_block_4  # unwired: x
replaceByCondition = Replace(item=if_, replaceWith=getParameterValueByName_3, condition=gt)
code_block_6 = CodeBlock { 3; }
eq_3 = _ == code_block_4  # unwired: x
replaceByCondition_2 = Replace(item=replaceByCondition, replaceWith=code_block_6, condition=eq_3)

code_block_7 = CodeBlock(DoorWidth=replaceByCondition_2) { DoorWidth; }

# group: Gets coordinates and create vector following facing orientation
get_cs = Python(IN[0]=final_list_of_doors.in)  # CPython3
# ---------- get_cs.python (21 lines) ----------
import sys
import clr
clr.AddReference('ProtoGeometry')
from Autodesk.DesignScript.Geometry import *

items = UnwrapElement(IN[0]) #IN[0] 
geoms = []

for item in items:
	tr = item.GetTransform()
	originft = Vector.ByCoordinates( tr.Origin.X, tr.Origin.Y, tr.Origin.Z)
	origin = Vector.AsPoint (Vector.Scale(originft, 1))
	x = Vector.ByCoordinates( tr.BasisX.X, tr.BasisX.Y, tr.BasisX.Z)
	y = Vector.ByCoordinates( tr.BasisY.X, tr.BasisY.Y, tr.BasisY.Z)
	z =	Vector.ByCoordinates( tr.BasisZ.X, tr.BasisZ.Y, tr.BasisZ.Z)

	geo = CoordinateSystem.ByOriginVectors(origin, x, y, z)
	geoms.append(geo)

# Assign your output to the OUT variable.
OUT = geoms
# ----------------------------------------
facingOrientation = FamilyInstance.FacingOrientation(familyInstance=final_list_of_doors.in)
origin = CoordinateSystem.Origin(coordinateSystem=get_cs)
byStartPointDirectionLength = Line.ByStartPointDirectionLength(startPoint=origin, direction=facingOrientation, length=code_block_7)

code_block_8 = CodeBlock(x=code_block_7) { x+1.5; }

# group: Gets wall thickness
getHost_2 = FamilyInstance.GetHost(familyInstance=final_list_of_doors.in)
elementType_4 = Element.ElementType(element=getHost_2)
string_4 = StringInput("Width")
getParameterValueByName_4 = Element.GetParameterValueByName(element=elementType_4, parameterName=string_4)

# group: Adds value for null results of wall width
code_block_9 = CodeBlock { 0.01; }
ge = getParameterValueByName_4 >= code_block_9
code_block_10 = CodeBlock { 0; 1; }
if_2 = RefactoredIf(test=ge, true=code_block_10.out0, false=code_block_10.out1)
eq_4 = _ == code_block_10.out0  # unwired: x
replaceByCondition_3 = Replace(item=if_2, replaceWith=getParameterValueByName_4, condition=eq_4)

# group: Gets hand orientation and reverse the vector to direct it to the pull-side area
handOrientation = Custom[FamilyInstance.HandOrientation](familyInstance=final_list_of_doors.in)  # package Clockwork for Dynamo 2.x; Gets the hand orientation of a hosted object (e.g. a window or a door)
reverse = Vector.Reverse(vector=handOrientation)

# group: Creates cuboid on endpoint of curves. move cuboid in the z axis
byLengths = Cuboid.ByLengths(coordinateSystem=get_cs, width=code_block_8, length=code_block_7, height=code_block_7)
formula = Formula("x/2+1.5", x=replaceByCondition_3)
translate = Geometry.Translate(geometry=byLengths, direction=facingOrientation, distance=formula)
number = DoubleInput(0.75)
translate_2 = Geometry.Translate(geometry=translate, direction=reverse, distance=number)
number_2 = DoubleInput(3)
translate_3 = Geometry.Translate(geometry=translate_2, zTranslation=number_2, lacing=Longest)

# group: Intersects doors with walls, furniture, casework, plumbing fixture and mechanical equipment
categories = Categories("OST_Walls")
all_elements_of_category = ElementsOfCategory(Category=categories)
setDifference = List.SetDifference(list1=all_elements_of_category, list2=getHost)
categories_2 = Categories("OST_Furniture")
categories_3 = Categories("OST_Casework")
categories_4 = Categories("OST_PlumbingFixtures")
categories_5 = Categories("OST_MechanicalEquipment")
list_create = List.Create(item0=categories_2, item1=categories_3, item2=categories_4, item3=categories_5)
all_elements_of_category_2 = ElementsOfCategory(Category=list_create)
list_create_2 = List.Create(item0=setDifference, item1=all_elements_of_category_2)
flatten_3 = List.Flatten(list=list_create_2)

# group: Runs intersection
intersectsSolid = Revit.Element.IntersectsSolid(solids=translate_3, elements=flatten_3)

# group: Gets results and clean lists
intersectingElements = Results.SolidIntersectionResult.IntersectingElements(solidIntersectionResult=intersectsSolid)
number_3 = DoubleInput(1)
takeItems = List.TakeItems(list=intersectingElements@@L2, amount=number_3)

# group: Replace empty lists with "No intersection"
code_block_11 = CodeBlock { "No intersection"; }
replaceEmptyList = archilab.Lists.Lists.ReplaceEmptyList(list=takeItems, replacement=code_block_11)
flatten_4 = List.Flatten(list=replaceEmptyList)

# group: Filters lists by intersection or clear
isNotEmpty = Custom[List.IsNotEmpty](seq=takeItems@L2)  # package Clockwork for Dynamo 2.x; Just the inversion of the built-in Is Empty List node.
filterByBoolMask_2 = List.FilterByBoolMask(list=takeItems, mask=isNotEmpty)
flatten_5 = List.Flatten(list=filterByBoolMask_2.in)

# group: Get indices of intersecting items
allIndicesOf = List.AllIndicesOf(list=flatten_4, item=flatten_5)
flatten_6 = List.Flatten(list=allIndicesOf)
uniqueItems_2 = List.UniqueItems(list=flatten_6)

boolean = BoolSelector(false)

# group: Sets value "Review Intersection " for parameter
getItemAtIndex = List.GetItemAtIndex(list=final_list_of_doors.in, index=uniqueItems_2)
flatten_7 = List.Flatten(list=getItemAtIndex)
clean = List.Clean(list=flatten_7, preserveIndices=boolean)
string_5 = StringInput("DoorClearance")
string_6 = StringInput("Review Intersection")
setParameterByName = Element.SetParameterByName(element=clean, parameterName=string_5, value=string_6)

# group: get original list of doors and subtract elements from list of intersecting items
setDifference_2 = List.SetDifference(list1=final_list_of_doors.in, list2=clean)

# group: Sets value "Clear " for parameter
string_7 = StringInput("DoorClearance")
string_8 = StringInput("Clear")
setParameterByName_2 = Element.SetParameterByName(element=setDifference_2, parameterName=string_7, value=string_8)

# group: Shows output
count_2 = List.Count(list=setParameterByName)
code_block_12 = CodeBlock(number=count_2) { "Number of doors to review: " + number; }
results = Watch(code_block_12)  # graph output

# group: Selects views
select_view_to_highlight_issues = Views("ZZ - DESIGN CHECK")  # "Select View to Highlight Issues (it should be at the end of the list, such as ZZ - DESIGN CHECK)"; graph input

# group: Creates curve in revit just for check
byCurve = Custom[DetailCurve.ByCurve+](curve=byStartPointDirectionLength, view=select_view_to_highlight_issues)  # package Clockwork for Dynamo 2.x; Creates a detail line based on a given curve. Unlike the OOTB node it can also draw circles.
endPoint = Curve.EndPoint(curve=byStartPointDirectionLength)
byStartPointDirectionLength_2 = Line.ByStartPointDirectionLength(startPoint=endPoint, direction=reverse, length=code_block_7)
byCurve_2 = Custom[DetailCurve.ByCurve+](curve=byStartPointDirectionLength_2, view=select_view_to_highlight_issues)

flatten_8 = List.Flatten()  # unwired: list
watch_3d = Watch3D(translate_3)
