# Dynamo graph EgressRouteAnalysis.dyn (Dynamo 2.16.2.5624)
# packages: spring nodes 210.1.1, Clockwork for Dynamo 2.x 2.6.0

# group: INPUTS
# note: These groups of nodes will represent information that should be manually or automatically added in order to run the algorithm

# group: DYNAMO GEOMETRIES
# note: These groups will contain nodes that generate geometries to be interpreted by Dynamo

# group: PROCESSES
# note: These groups of nodes will represent actions such as retrieve information, perform intersections, create lists, flatten lists, etc.

# group: OUTPUTS
# note: These groups will include nodes that will show the results generated. These outputs will be also shown in Dynamo Player

# group: INSTRUCTIONS
# note: These nodes will indicate important instruction to adjust elements in the Dynamo Scripts

# group: Sets view to create path of travel lines
view_to_create_path_of_travel = Views("EGRESS CHECK Copy 1 Copy 1")  # "View to create Path of Travel lines (it is located at end of the list, default: ZZ - EGRESS CHECK)"; graph input

# group: Gets all rooms from selected level
# note: Egress Route Analysis
# note: Information:
# Date: Jun-2024
# Developed By: Ingrid Freire
# as a part of her Master's dissertation
# European Master in Building Information Modelling
# Universidade do Minho
categories = Categories("OST_Rooms")
all_elements_of_category = ElementsOfCategory(Category=categories)
level = Custom[Element.Level](element=all_elements_of_category)  # package Clockwork for Dynamo 2.x; Gets an element's level
string_from_object = FromObject(object=level)
level_to_be_tested = Levels("Level 1")  # graph input
string_from_object_2 = FromObject(object=level_to_be_tested)
contains = String.Contains(string=string_from_object, searchFor=string_from_object_2)
filterByBoolMask = List.FilterByBoolMask(list=all_elements_of_category, mask=contains)

# group: Gets Finish Boundaries and offsets them inward
finishBoundary = Room.FinishBoundary(room=filterByBoolMask.in)
byJoinedCurves = PolyCurve.ByJoinedCurves(curves=finishBoundary)
closeWithLine = PolyCurve.CloseWithLine(polyCurve=byJoinedCurves)
number = DoubleInput(-2)
offsetMany = Curve.OffsetMany(curve=closeWithLine, signedDistance=number)
ꟿ_polycurve_points = Custom[ꟿ PolyCurve.Points](polyCurve=offsetMany)  # package spring nodes; Gets all the unique start and end points of the underlying curves in a sorted list.
code_block = CodeBlock { 1; }

# group: Flatten
flatten = List.Flatten(list=ꟿ_polycurve_points, amount=code_block)

boolean = BoolSelector(false)

# group: Gets location of doors assigned as "ExitDoors"
categories_2 = Categories("OST_Doors")
all_elements_of_category_2 = ElementsOfCategory(Category=categories_2)
level_2 = Custom[Element.Level](element=all_elements_of_category_2)
string_from_object_3 = FromObject(object=level_2)
string_from_object_4 = FromObject(object=level_to_be_tested)
contains_2 = String.Contains(string=string_from_object_3, searchFor=string_from_object_4)
filterByBoolMask_2 = List.FilterByBoolMask(list=all_elements_of_category_2, mask=contains_2)
code_block_2 = CodeBlock { "ExitDoor"; }
getParameterValueByName = Element.GetParameterValueByName(element=filterByBoolMask_2.in, parameterName=code_block_2)
number_2 = DoubleInput(1)
eq = getParameterValueByName == number_2
filterByBoolMask_3 = List.FilterByBoolMask(list=filterByBoolMask_2.in, mask=eq)
get_cs = Python(IN[0]=filterByBoolMask_3.in)  # CPython3
# ---------- get_cs.python (21 lines) ----------
import sys
import clr
clr.AddReference('ProtoGeometry')
from Autodesk.DesignScript.Geometry import *

items = UnwrapElement(IN[0]) #IN[0] 
geoms = []

for item in items:
	tr = item.GetTransform()
	originft = Vector.ByCoordinates( tr.Origin.X, tr.Origin.Y, tr.Origin.Z)
	origin = Vector.AsPoint (Vector.Scale(originft, 1))
	x = Vector.ByCoordinates( tr.BasisX.X, tr.BasisX.Y, tr.BasisX.Z)
	y = Vector.ByCoordinates( tr.BasisY.X, tr.BasisY.Y, tr.BasisY.Z)
	z =	Vector.ByCoordinates( tr.BasisZ.X, tr.BasisZ.Y, tr.BasisZ.Z)

	geo = CoordinateSystem.ByOriginVectors(origin, x, y, z)
	geoms.append(geo)

# Assign your output to the OUT variable.
OUT = geoms
# ----------------------------------------
origin = CoordinateSystem.Origin(coordinateSystem=get_cs)

# group: Generates path of travel lines and clean results (delete null values)
clean = List.Clean(list=flatten, preserveIndices=boolean)
boolean_2 = BoolSelector(true)
byFloorPlanPoints = PathOfTravel.ByFloorPlanPoints(floorPlan=view_to_create_path_of_travel, startPtsList=clean, endPtsList=origin@@L1, manyToMany=boolean_2)
boolean_3 = BoolSelector(false)
clean_2 = List.Clean(list=byFloorPlanPoints, preserveIndices=boolean_3)
code_block_3 = CodeBlock { "Length"; }

# group: Gets lengths and sum the values
getParameterValueByName_2 = Element.GetParameterValueByName(element=clean_2, parameterName=code_block_3)
sum = Math.Sum(values=getParameterValueByName_2)

# group: Transpose lists to compare distance to each door
transpose = List.Transpose(lists=sum)

# group: filters the shortest paths (to get the closest exit door of each room)
minimumItem = List.MinimumItem(list=transpose)
ꟿ_list_nullallindicesof = Custom[ꟿ List.NullAllIndicesOf](list=sum@@L2, value=minimumItem)  # package spring nodes; list all of the indices of a list that match the specified value. Capable of handling null values, part of the SmartCopyMonitor workflow.
code_block_4 = CodeBlock { 1; }
flatten_2 = List.Flatten(list=ꟿ_list_nullallindicesof@L3, amount=code_block_4)
getItemAtIndex = List.GetItemAtIndex(list=clean_2@L3, index=flatten_2@L2)

# group: Filters the longest path of travel of each room (most remote point)
code_block_5 = CodeBlock { "Length"; }
getParameterValueByName_3 = Element.GetParameterValueByName(element=getItemAtIndex, parameterName=code_block_5)
maximumItem = List.MaximumItem(list=getParameterValueByName_3)
ꟿ_list_nullallindicesof_2 = Custom[ꟿ List.NullAllIndicesOf](list=getParameterValueByName_3, value=maximumItem)
code_block_6 = CodeBlock { 1; }
flatten_3 = List.Flatten(list=ꟿ_list_nullallindicesof_2@L3, amount=code_block_6)
getItemAtIndex_2 = List.GetItemAtIndex(list=getItemAtIndex@L2, index=flatten_3@L1)

# group: Assign values "IN" for one path of travel from each room
string = StringInput("Mark")
code_block_7 = CodeBlock { "IN"; }
setParameterByName = Element.SetParameterByName(element=getItemAtIndex_2, parameterName=string, value=code_block_7)

# group: Gets longest of shortest travel paths
string_2 = StringInput("Length")
getParameterValueByName_4 = Element.GetParameterValueByName(element=setParameterByName, parameterName=string_2)
maximumItem_2 = List.MaximumItem(list=getParameterValueByName_4)
longest_of_shortest_paths_of = Watch(maximumItem_2)  # "Longest of shortest paths of travel"; graph output

# group: Filters 5 longest paths and overrides them in view
boolean_4 = BoolSelector(false)
clean_3 = List.Clean(list=getParameterValueByName_4, preserveIndices=boolean_4)
sort = List.Sort(list=clean_3)
reverse = List.Reverse(list=sort)
number_3 = DoubleInput(5)
takeItems = List.TakeItems(list=reverse, amount=number_3)
ꟿ_list_nullallindicesof_3 = Custom[ꟿ List.NullAllIndicesOf](list=getParameterValueByName_4, value=takeItems)
flatten_4 = List.Flatten(list=ꟿ_list_nullallindicesof_3)
getItemAtIndex_3 = List.GetItemAtIndex(list=setParameterByName, index=flatten_4)
code_block_8 = CodeBlock { 0; 255; }
byARGB = Color.ByARGB(alpha=code_block_8.out0, red=code_block_8.out1, green=code_block_8.out0, blue=code_block_8.out0)
code_block_9 = CodeBlock { 5; }
byProperties = Revit.Filter.OverrideGraphicSettings.ByProperties(projectionLineColor=byARGB, projectionLineWeight=code_block_9)
overrideInView = Element.OverrideInView(element=getItemAtIndex_3, overrides=byProperties)

flatten_5 = List.Flatten(list=clean_2)

# group: Assign values "OUT" for the rest of the paths of travel
setDifference = List.SetDifference(list1=flatten_5, list2=getItemAtIndex_2)
string_3 = StringInput("Mark")
code_block_10 = CodeBlock { "OUT"; }
setParameterByName_2 = Element.SetParameterByName(element=setDifference, parameterName=string_3, value=code_block_10)
