# Dynamo graph ExitDoorSwingDirection.dyn (Dynamo 2.16.2.5624)
# packages: Clockwork for Dynamo 2.x 2.6.0, spring nodes 210.1.1

# group: Collects doors
categories = Categories("OST_Doors")
all_elements_of_category = ElementsOfCategory(Category=categories)

# group: Filters doors by function exterior
elementType = Element.ElementType(element=all_elements_of_category)
function = Custom[FamilyType.Function](familyType=elementType)  # package Clockwork for Dynamo 2.x; Retrieves the Function property of a given family type (if it has that property)
code_block = CodeBlock { "Exterior"; }
eq = function == code_block
filterByBoolMask = List.FilterByBoolMask(list=all_elements_of_category, mask=eq)
watch = Watch(filterByBoolMask.in)

# group: Input (phase)
select_phase = RevitPhases()  # nothing selected; graph input

# group: Gets rooms associated with doors (select phase)
rooms = Custom[Door.Rooms](door=watch, phase=select_phase)  # package Clockwork for Dynamo 2.x; Gets the rooms that are connected by a given door

# group: From room. replace null values with Exterior
number = Room.Number(room=rooms.fromRoom)
string = StringInput("Exterior")
replaceNull = Custom[List.ReplaceNull](seq=number, replacement=string)  # package Clockwork for Dynamo 2.x; Replaces all null values within a given list with a substitute

# group: Filters doors that "FromRoom" values are exterior
eq_2 = replaceNull == string
filterByBoolMask_2 = List.FilterByBoolMask(list=replaceNull, mask=eq_2)

flatten = List.Flatten(list=filterByBoolMask_2.in)

# group: To.room - Replaces null values with exterior
number_2 = Room.Number(room=rooms.toRoom)
replaceNull_2 = Custom[List.ReplaceNull](seq=number_2, replacement=string)

# group: Gets indices of items that are exterior from room. then get the items from the same indice from the ToRoom list
allIndicesOf = List.AllIndicesOf(list=replaceNull@L2, item=flatten@@L1)
flatten_2 = List.Flatten(list=allIndicesOf)
getItemAtIndex = List.GetItemAtIndex(list=replaceNull_2, index=flatten_2)

# group: Adds (EXTERIOR) in front of the room numbers from the ToRoom values
join = List.Join()  # unwired: list0, list1
string_from_object = FromObject(object=getItemAtIndex)
string_2 = StringInput("(EXTERIOR)")
count = List.Count(list=string_from_object)
ofRepeatedItem = List.OfRepeatedItem(item=string_2, amount=count)
combine = List.Combine(combineFunction=join, list0=string_from_object, list1=ofRepeatedItem)
concat = String.Concat(string0=combine)

flatten_3 = List.Flatten(list=concat)

# group: Replaces the item and set the parameter
string_3 = StringInput("Doors_From")
replaceItemAtIndex = Custom[List.ReplaceItemAtIndex+](seq=replaceNull, indices=flatten_2, replacement=flatten_3)  # package Clockwork for Dynamo 2.x; Replaces the item at a given index of a list by another item. Unlike the OOTB node, it can replace items at multiple indeces.
setParameterByName = Element.SetParameterByName(element=watch, parameterName=string_3, value=replaceItemAtIndex)

# group: Filters doors that "ToRoom" values are exterior
eq_3 = replaceNull_2 == string
filterByBoolMask_3 = List.FilterByBoolMask(list=replaceNull_2, mask=eq_3)

flatten_4 = List.Flatten(list=filterByBoolMask_3.in)

# group: Gets indices of items that are exterior from room. then get the items from the same indice from the FromRoom list
allIndicesOf_2 = List.AllIndicesOf(list=replaceNull_2@L2, item=flatten_4@@L1)
flatten_5 = List.Flatten(list=allIndicesOf_2)
getItemAtIndex_2 = List.GetItemAtIndex(list=replaceNull, index=flatten_5)

# group: Adds (EXTERIOR) in front of the room numbers from the ToRoom values
join_2 = List.Join()  # unwired: list0, list1
string_from_object_2 = FromObject(object=getItemAtIndex_2)
string_4 = StringInput("(EXTERIOR)")
count_2 = List.Count(list=string_from_object_2)
ofRepeatedItem_2 = List.OfRepeatedItem(item=string_4, amount=count_2)
combine_2 = List.Combine(combineFunction=join_2, list0=string_from_object_2, list1=ofRepeatedItem_2)
concat_2 = String.Concat(string0=combine_2)

flatten_6 = List.Flatten(list=concat_2)

# group: Replaces the items and set the parameter
string_5 = StringInput("Doors_To")
replaceItemAtIndex_2 = Custom[List.ReplaceItemAtIndex+](seq=replaceNull_2, indices=flatten_5, replacement=flatten_6)
setParameterByName_2 = Element.SetParameterByName(element=watch, parameterName=string_5, value=replaceItemAtIndex_2)

# group: Filters doors classifeid as exit doors
string_6 = StringInput("ExitDoor")
getParameterValueByName = Element.GetParameterValueByName(element=watch, parameterName=string_6)
number_3 = DoubleInput(1)
eq_4 = getParameterValueByName == number_3
filterByBoolMask_4 = List.FilterByBoolMask(list=watch, mask=eq_4)

# group: Filters doors with occupant load bigger than 50
code_block_2 = CodeBlock { "DoorOccupantLoad"; }
getParameterValueByName_2 = Element.GetParameterValueByName(element=filterByBoolMask_4.in, parameterName=code_block_2)
toNumber = String.ToNumber(string=getParameterValueByName_2)
code_block_3 = CodeBlock { 50; }
ge = _ >= code_block_3  # unwired: x
filter = List.Filter(list=toNumber, condition=ge)
ꟿ_list_nullallindicesof = Custom[ꟿ List.NullAllIndicesOf](list=toNumber, value=filter.in)  # package spring nodes; list all of the indices of a list that match the specified value. Capable of handling null values, part of the SmartCopyMonitor workflow.
flatten_7 = List.Flatten(list=ꟿ_list_nullallindicesof)
getItemAtIndex_3 = List.GetItemAtIndex(list=filterByBoolMask_4.in, index=flatten_7)

# group: Creates line using the start point at the origin of the door, the vector originated by the facing orientation and the length specified
get_cs = Python(IN[0]=getItemAtIndex_3)  # CPython3
# ---------- get_cs.python (21 lines) ----------
import sys
import clr
clr.AddReference('ProtoGeometry')
from Autodesk.DesignScript.Geometry import *

items = UnwrapElement(IN[0]) #IN[0] 
geoms = []

for item in items:
	tr = item.GetTransform()
	originft = Vector.ByCoordinates( tr.Origin.X, tr.Origin.Y, tr.Origin.Z)
	origin = Vector.AsPoint (Vector.Scale(originft, 1))
	x = Vector.ByCoordinates( tr.BasisX.X, tr.BasisX.Y, tr.BasisX.Z)
	y = Vector.ByCoordinates( tr.BasisY.X, tr.BasisY.Y, tr.BasisY.Z)
	z =	Vector.ByCoordinates( tr.BasisZ.X, tr.BasisZ.Y, tr.BasisZ.Z)

	geo = CoordinateSystem.ByOriginVectors(origin, x, y, z)
	geoms.append(geo)

# Assign your output to the OUT variable.
OUT = geoms
# ----------------------------------------
origin = CoordinateSystem.Origin(coordinateSystem=get_cs)
facingOrientation = FamilyInstance.FacingOrientation(familyInstance=getItemAtIndex_3)
number_4 = DoubleInput(2)
byStartPointDirectionLength = Line.ByStartPointDirectionLength(startPoint=origin, direction=facingOrientation, length=number_4)

# group: Creates curves just for checking (default: frozen)
view_to_create_the_path = Views()  # nothing selected; frozen
byCurve = DetailCurve.ByCurve(view=view_to_create_the_path, curve=byStartPointDirectionLength)  # frozen

# group: Check if the end point of a curve is inside room
categories_2 = Categories("OST_Rooms")
all_elements_of_category_2 = ElementsOfCategory(Category=categories_2)
endPoint = Curve.EndPoint(curve=byStartPointDirectionLength)
isInsideRoom = Room.IsInsideRoom(room=all_elements_of_category_2, point=endPoint, lacing=CrossProduct)
transpose = List.Transpose(lists=isInsideRoom)
anyTrue = List.AnyTrue(list=transpose@L2)

# group: Assigns results to parameter of doors with occupant load > 50
string_7 = StringInput("ExitDirection")
code_block_4 = CodeBlock { "Revise Swing Direction"; "PASS"; }
if_ = RefactoredIf(test=anyTrue, true=code_block_4.out0, false=code_block_4.out1)
setParameterByName_3 = Element.SetParameterByName(element=getItemAtIndex_3, parameterName=string_7, value=if_)

# group: Get doors with Occupant Load < 50
setDifference = List.SetDifference(list1=filterByBoolMask_4.in, list2=getItemAtIndex_3)

# group: Sets parameters for doors with occupant load less than 50
code_block_5 = CodeBlock { "ExitDirection"; }
code_block_6 = CodeBlock { "Occupant Load < 50"; }
setParameterByName_4 = Element.SetParameterByName(element=setDifference, parameterName=code_block_5, value=code_block_6)

# group: Displays results
code_block_7 = CodeBlock(doors50=setParameterByName_3, doornot50=setParameterByName_4) { doors50; doornot50; }
join_3 = List.Join(list0=code_block_7.doors50, list1=code_block_7.doornot50)
code_block_8 = CodeBlock { "Mark"; }
getParameterValueByName_3 = Element.GetParameterValueByName(element=join_3, parameterName=code_block_8)
getParameterValueByName_4 = Element.GetParameterValueByName(element=join_3, parameterName=string_7)
code_block_9 = CodeBlock(x=getParameterValueByName_3, y=getParameterValueByName_4) { "Door: " +x+" - Result: " +y; }
results = Watch(code_block_9)  # graph output

# group: Sets DoorLocation for exterior doors
string_8 = StringInput("DoorLocation")
join_4 = List.Join()  # unwired: list0, list1
combine_3 = List.Combine(combineFunction=join_4, list0=replaceItemAtIndex, list1=replaceItemAtIndex_2)
code_block_10 = CodeBlock { "(EXTERIOR)"; }
contains = String.Contains(searchFor=code_block_10)  # unwired: string
sortByFunction = List.SortByFunction(list=combine_3@@L2, sortFunction=contains)
lastItem = List.LastItem(list=sortByFunction@@L2)
setParameterByName_5 = Element.SetParameterByName(element=watch, parameterName=string_8, value=lastItem)

# group: Set door location parameter for interior doors
code_block_11 = CodeBlock(InteriorDoorsList=filterByBoolMask.out) { InteriorDoorsList; }
string_9 = StringInput("DoorLocation")
rooms_2 = Custom[Door.Rooms](door=code_block_11, phase=select_phase)
number_5 = Room.Number(room=rooms_2.toRoom)
setParameterByName_6 = Element.SetParameterByName(element=code_block_11, parameterName=string_9, value=number_5)
