# Dynamo graph FireRatedWallsAppBay.dyn (Dynamo 2.16.2.5624)
# packages: Clockwork for Dynamo 2.x 2.6.0, archi-lab.net 2024.217.1024

# group: INPUTS
# note: These groups of nodes will represent information that should be manually or automatically added in order to run the algorithm

# group: DYNAMO GEOMETRIES
# note: These groups will contain nodes that generate geometries to be interpreted by Dynamo

# group: PROCESSES
# note: These groups of nodes will represent actions such as retrieve information, perform intersections, create lists, flatten lists, etc.

# group: OUTPUTS
# note: These groups will include nodes that will show the results generated. These outputs will be also shown in Dynamo Player

# group: INSTRUCTIONS
# note: These nodes will indicate important instruction to adjust elements in the Dynamo Scripts

# group: Gets App Bay room by providing the room's name
# note: Fire Rating Checking - Apparatus Bays
categories = Categories("OST_Rooms")
all_elements_of_category = ElementsOfCategory(Category=categories)
name = Room.Name(room=all_elements_of_category)
# note: Information:
# Date: Jun-2024
# Developed By: Ingrid Freire
# as a part of her Master's dissertation
# European Master in Building Information Modelling
# Universidade do Minho
insert_exact_room_s_name_for_the = StringInput("APPARATUS BAY")  # "Insert exact room's name for the Apparatus Bays - case sensitive, e.g.: App Bay, APP BAY, Apparatus Bays.."; graph input
eq = name == insert_exact_room_s_name_for_the
filterByBoolMask = List.FilterByBoolMask(list=all_elements_of_category, mask=eq)
watch = Watch(filterByBoolMask.in)

# group: Extracts elements enclosing the room and filters the walls
boundaries = Custom[Room.Boundaries](room=watch)  # package Clockwork for Dynamo 2.x; Gets a list of all boundaries of a given room or area and a corresponding list of the elements that are generating those boundaries.
string_from_object = FromObject(object=boundaries.elements)
code_block = CodeBlock { "Wall"; }
contains = String.Contains(string=string_from_object, searchFor=code_block)
filterByBoolMask_2 = List.FilterByBoolMask(list=boundaries.elements, mask=contains)

# group: Filter walls by function Interior
wallType = archilab.Revit.Elements.Walls.WallType(wall=filterByBoolMask_2.in)
function = WallType.Function(wallType=wallType)
string = StringInput("Interior")
eq_2 = function == string
final_list_of_walls = List.FilterByBoolMask(list=wallType, mask=eq_2)

# group: Filter interior walltypes and retrieve the wall instances of these types
flatten = List.Flatten(list=wallType)
flatten_2 = List.Flatten(list=final_list_of_walls.in)
allIndicesOf = List.AllIndicesOf(list=flatten, item=flatten_2)
uniqueItems = List.UniqueItems(list=allIndicesOf)
flatten_3 = List.Flatten(list=uniqueItems)
getItemAtIndex = List.GetItemAtIndex(list=filterByBoolMask_2.in@L2, index=flatten_3)

# group: Gets the value of the parameter "Fire Rating"
code_block_2 = CodeBlock { "Fire Rating"; }
getParameterValueByName = Element.GetParameterValueByName(element=getItemAtIndex, parameterName=code_block_2)
string_2 = StringInput("-")
ne = getParameterValueByName != string_2

# group: Sets parameter value with results for Fire Rating properties
code_block_3 = CodeBlock { "FireRatingCheck"; }
code_block_4 = CodeBlock { "PASS"; "Revise Fire Rating"; }
if_ = RefactoredIf(test=ne, true=code_block_4.out0, false=code_block_4.out1)
setParameterByName = Element.SetParameterByName(element=getItemAtIndex, parameterName=code_block_3, value=if_)

# group: Gets the value of the parameter "Top is Attached"
code_block_5 = CodeBlock { "Top is Attached"; }
getParameterValueByName_2 = Element.GetParameterValueByName(element=getItemAtIndex, parameterName=code_block_5)
string_from_object_2 = FromObject(object=getParameterValueByName_2)
code_block_6 = CodeBlock { "0"; }
eq_3 = string_from_object_2 == code_block_6

# group: Sets parameter value with results for attachment
code_block_7 = CodeBlock { "FireRatedWallIsAttached"; }
code_block_8 = CodeBlock { "Revise Wall Attachment"; "PASS"; }
if_2 = RefactoredIf(test=eq_3, true=code_block_8.out0, false=code_block_8.out1)
setParameterByName_2 = Element.SetParameterByName(element=getItemAtIndex, parameterName=code_block_7, value=if_2)

# group: Gets number of walls to revise attachment
countTrue = List.CountTrue(list=eq_3)
number_of_walls_to_revise = Watch(countTrue)  # "Number of walls to revise attachment"; graph output

# group: Extract doors enclosing the room
confirm_phase = RevitPhases()  # nothing selected; graph input
doors = Custom[Room.Doors](room=watch, phase=confirm_phase)  # package Clockwork for Dynamo 2.x; Retrieves all doors that are associated with a room (hosted in walls and roofs).

# group: Gets the value of the parameter "Fire Rating" for Doors
elementType = Element.ElementType(element=doors)
code_block_9 = CodeBlock { "Fire Rating"; }
getParameterValueByName_3 = Element.GetParameterValueByName(element=elementType, parameterName=code_block_9)
code_block_10 = CodeBlock { "-"; }
eq_4 = getParameterValueByName_3 == code_block_10
filterByBoolMask_3 = List.FilterByBoolMask(list=elementType, mask=eq_4)
allIndicesOf_2 = List.AllIndicesOf(list=elementType@L2, item=filterByBoolMask_3.out@L2)
flatten_4 = List.Flatten(list=allIndicesOf_2)
getItemAtIndex_2 = List.GetItemAtIndex(list=doors@L2, index=flatten_4)
allIndicesOf_3 = List.AllIndicesOf(list=elementType@L2, item=filterByBoolMask_3.in@L2)
flatten_5 = List.Flatten(list=allIndicesOf_3)
getItemAtIndex_3 = List.GetItemAtIndex(list=doors@L2, index=flatten_5)

# group: Gets number of doors to revise fire rating
count = List.Count(list=getItemAtIndex_2)
number_of_doors_to_revise_fire = Watch(count)  # "Number of doors to revise fire rating"; graph output

# group: Sets parameter value with results for attachment
code_block_11 = CodeBlock { "DoorFireRating"; }
code_block_12 = CodeBlock { "Revise Fire Rating"; "PASS"; }
setParameterByName_3 = Element.SetParameterByName(element=getItemAtIndex_2, parameterName=code_block_11, value=code_block_12.out1)
setParameterByName_4 = Element.SetParameterByName(element=getItemAtIndex_3, parameterName=code_block_11, value=code_block_12.out0)

# group: Gets number of walls to revise fire rating
countFalse = List.CountFalse(list=ne)
number_of_walls_to_revise_fire = Watch(countFalse)  # "Number of walls to revise fire rating property"; graph output
