# Dynamo graph FireRatedWallsSleepRooms.dyn (Dynamo 2.16.2.5624)
# packages: Clockwork for Dynamo 2.x 2.6.0, archi-lab.net 2024.217.1024

# group: INPUTS
# note: These groups of nodes will represent information that should be manually or automatically added in order to run the algorithm

# group: DYNAMO GEOMETRIES
# note: These groups will contain nodes that generate geometries to be interpreted by Dynamo

# group: PROCESSES
# note: These groups of nodes will represent actions such as retrieve information, perform intersections, create lists, flatten lists, etc.

# group: OUTPUTS
# note: These groups will include nodes that will show the results generated. These outputs will be also shown in Dynamo Player

# group: INSTRUCTIONS
# note: These nodes will indicate important instruction to adjust elements in the Dynamo Scripts

# group: Gets Sleep rooms by providing the room's name
# note: Fire Rating Checking - Apparatus Bays
categories = Categories("OST_Rooms")
all_elements_of_category = ElementsOfCategory(Category=categories)
name = Room.Name(room=all_elements_of_category)
# note: Information:
# Date: Jun-2024
# Developed By: Ingrid Freire
# as a part of her Master's dissertation
# European Master in Building Information Modelling
# Universidade do Minho
insert_common_name_for_the_sleep = StringInput("SLEEP ROOM")  # "Insert common name for the Sleep Rooms - case sensitive, e.g.: Sleep Room, SR, SLEEP ROOM.."; graph input
contains = String.Contains(string=name, searchFor=insert_common_name_for_the_sleep)
filterByBoolMask = List.FilterByBoolMask(list=all_elements_of_category, mask=contains)
watch = Watch(filterByBoolMask.in)

# group: Extracts elements enclosing the room and filters the walls
boundaries = Custom[Room.Boundaries](room=watch)  # package Clockwork for Dynamo 2.x; Gets a list of all boundaries of a given room or area and a corresponding list of the elements that are generating those boundaries.
string_from_object = FromObject(object=boundaries.elements)
code_block = CodeBlock { "Wall"; }
contains_2 = String.Contains(string=string_from_object, searchFor=code_block)
filterByBoolMask_2 = List.FilterByBoolMask(list=boundaries.elements, mask=contains_2)

# group: Filter walls by function Interior
wallType = archilab.Revit.Elements.Walls.WallType(wall=filterByBoolMask_2.in@L2)
function = WallType.Function(wallType=wallType)
string = StringInput("Interior")
eq = function == string
final_list_of_walls = List.FilterByBoolMask(list=wallType, mask=eq)

# group: Filter interior walltypes and retrieve the wall instances of these types
allIndicesOf = List.AllIndicesOf(list=wallType@L2, item=final_list_of_walls.in@L1)
getItemAtIndex = List.GetItemAtIndex(list=filterByBoolMask_2.in@L2, index=allIndicesOf@L2)

# group: Filters unique items
flatten = List.Flatten(list=getItemAtIndex)
uniqueItems = List.UniqueItems(list=flatten)
wallType_2 = archilab.Revit.Elements.Walls.WallType(wall=uniqueItems)

# group: Gets the value of the parameter "Fire Rating"
code_block_2 = CodeBlock { "Fire Rating"; }
getParameterValueByName = Element.GetParameterValueByName(element=wallType_2, parameterName=code_block_2)
string_2 = StringInput("-")
ne = getParameterValueByName != string_2

# group: Sets parameter value with results for Fire Rating properties
code_block_3 = CodeBlock { "FireRatingCheck"; }
code_block_4 = CodeBlock { "PASS"; "Revise Fire Rating"; }
if_ = RefactoredIf(test=ne, true=code_block_4.out0, false=code_block_4.out1)
setParameterByName = Element.SetParameterByName(element=uniqueItems, parameterName=code_block_3, value=if_)

# group: Gets the value of the parameter "Top is Attached"
code_block_5 = CodeBlock { "Top is Attached"; }
getParameterValueByName_2 = Element.GetParameterValueByName(element=uniqueItems, parameterName=code_block_5)
string_from_object_2 = FromObject(object=getParameterValueByName_2)
code_block_6 = CodeBlock { "0"; }
eq_2 = string_from_object_2 == code_block_6

# group: Sets parameter value with results for attachment
code_block_7 = CodeBlock { "FireRatedWallIsAttached"; }
code_block_8 = CodeBlock { "Revise Wall Attachment"; "PASS"; }
if_2 = RefactoredIf(test=eq_2, true=code_block_8.out0, false=code_block_8.out1)
setParameterByName_2 = Element.SetParameterByName(element=uniqueItems, parameterName=code_block_7, value=if_2)

# group: Gets number of walls to revise attachment
countTrue = List.CountTrue(list=eq_2)
number_of_walls_to_revise = Watch(countTrue)  # "Number of walls to revise attachment"; graph output

# group: Select phase
confirm_phase = RevitPhases("New Construction")  # graph input

# group: Extract doors enclosing the room
doors = Custom[Room.Doors](room=watch, phase=confirm_phase)  # package Clockwork for Dynamo 2.x; Retrieves all doors that are associated with a room (hosted in walls and roofs).

flatten_2 = List.Flatten(list=doors)

# group: Gets the value of the parameter "Fire Rating" for Doors
elementType = Element.ElementType(element=flatten_2)
code_block_9 = CodeBlock { "Fire Rating"; }
getParameterValueByName_3 = Element.GetParameterValueByName(element=elementType, parameterName=code_block_9)
code_block_10 = CodeBlock { "-"; }
eq_3 = getParameterValueByName_3 == code_block_10
filterByBoolMask_3 = List.FilterByBoolMask(list=elementType, mask=eq_3)
allIndicesOf_2 = List.AllIndicesOf(list=elementType, item=filterByBoolMask_3.in)
uniqueItems_2 = List.UniqueItems(list=allIndicesOf_2)
getItemAtIndex_2 = List.GetItemAtIndex(list=flatten_2, index=uniqueItems_2)
allIndicesOf_3 = List.AllIndicesOf(list=elementType, item=filterByBoolMask_3.out)
uniqueItems_3 = List.UniqueItems(list=allIndicesOf_3)
getItemAtIndex_3 = List.GetItemAtIndex(list=flatten_2, index=uniqueItems_3)

flatten_3 = List.Flatten(list=getItemAtIndex_2)

# group: Gets number of doors to revise fire rating
count = List.Count(list=flatten_3)
number_of_doors_to_revise_fire = Watch(count)  # "Number of doors to revise fire rating"; graph output

flatten_4 = List.Flatten(list=getItemAtIndex_3)

# group: Sets parameter value with results doors fire rating
code_block_11 = CodeBlock { "DoorFireRating"; }
code_block_12 = CodeBlock { "Revise Fire Rating"; "PASS"; }
setParameterByName_3 = Element.SetParameterByName(element=flatten_4, parameterName=code_block_11, value=code_block_12.out1)
setParameterByName_4 = Element.SetParameterByName(element=flatten_3, parameterName=code_block_11, value=code_block_12.out0)

# group: Gets number of walls to revise fire rating
countFalse = List.CountFalse(list=ne)
number_of_walls_to_revise_fire = Watch(countFalse)  # "Number of walls to revise fire rating property"; graph output
