# Dynamo graph HallwaysClearance.dyn (Dynamo 2.16.2.5624)
# packages: Clockwork for Dynamo 2.x 2.6.0

# note: Hallway Clearance Checking
# note: Information:
# Date: Jun-2024
# Developed By: Ingrid Freire
# as a part of her Master's dissertation
# European Master in Building Information Modelling
# Universidade do Minho

# group: INPUTS
# note: These groups of nodes will represent information that should be manually or automatically added in order to run the algorithm

# group: DYNAMO GEOMETRIES
# note: These groups will contain nodes that generate geometries to be interpreted by Dynamo

# group: PROCESSES
# note: These groups of nodes will represent actions such as retrieve information, perform intersections, create lists, flatten lists, etc.

# group: OUTPUTS
# note: These groups will include nodes that will show the results generated. These outputs will be also shown in Dynamo Player

# group: INSTRUCTIONS
# note: These nodes will indicate important instruction to adjust elements in the Dynamo Scripts

# group: Gets name used for Hall
insert_name_used_for_hall_e_g = StringInput("HALL")  # "Insert name used for hall (e.g. hallway, hall, corridor..)"; graph input

# group: Gets rooms that are named as Halls/Hallways
categories = Categories("OST_Rooms")
all_elements_of_category = ElementsOfCategory(Category=categories)
name = Room.Name(room=all_elements_of_category)
string_from_object = FromObject(object=name)
contains = String.Contains(string=string_from_object, searchFor=insert_name_used_for_hall_e_g)
filterByBoolMask = List.FilterByBoolMask(list=all_elements_of_category, mask=contains)

# group: Gets room boundaries and move boundaries up
finishBoundary = Room.FinishBoundary(room=filterByBoolMask.in)
number = DoubleInput(3)
translate = Geometry.Translate(geometry=finishBoundary, zTranslation=number)

# group: Creates solids from room boundaries
pointAtSegmentLength = Curve.PointAtSegmentLength(curve=translate)
boolean = BoolSelector(true)
byPoints = PolyCurve.ByPoints(points=pointAtSegmentLength, connectLastToFirst=boolean)
byPatch = Surface.ByPatch(closedCurve=byPoints)
thicken = Surface.Thicken(surface=byPatch)
byUnion = Custom[Solid.ByUnion+](solids=thicken@@L2)  # package Clockwork for Dynamo 2.x; The OOTB node Solid.ByUnion occasionally fails when trying to merge solids with almost adjacent faces. This node will return the minimum amount of joined solids possible in such cases instead of returning null.

# group: Transforms solids into surfaces and get only vertical surfaces
bySolid = PolySurface.BySolid(solid=byUnion)
surfaces = PolySurface.Surfaces(polySurface=bySolid)
filterByOrientation = Custom[Surface.FilterByOrientation](surfaces=surfaces)  # package Clockwork for Dynamo 2.x; Sorts surfaces in three lists based on their orientation (vertical, horizontal up & horizontal down) and also returns three corresponding lists of booleans.
watch = Watch(filterByOrientation.vertical)
flatten = List.Flatten(list=watch)

# group: Creates lines using the normal vector
code_block = CodeBlock { 0.5; }
pointAtParameter = Surface.PointAtParameter(surface=watch, u=code_block, v=code_block)
normalAtParameter = Surface.NormalAtParameter(surface=watch, u=code_block, v=code_block)
code_block_2 = CodeBlock { -15; }
byStartPointDirectionLength = Line.ByStartPointDirectionLength(startPoint=pointAtParameter, direction=normalAtParameter, length=code_block_2)

# group: Gets intersection geometry of these lines with the solids
intersect = Geometry.Intersect(geometry=byStartPointDirectionLength, other=byUnion@L1, lacing=Longest)
code_block_3 = CodeBlock { 1; }
flatten_2 = List.Flatten(list=intersect, amount=code_block_3)
code_block_4 = CodeBlock { "Autodesk.DesignScript.Geometry.Line"; }
removeIfNot = List.RemoveIfNot(list=flatten_2@@L2, type=code_block_4)
code_block_5 = CodeBlock { 2; }
flatten_3 = List.Flatten(list=removeIfNot@L3, amount=code_block_5)
length = Curve.Length(curve=flatten_3)
code_block_6 = CodeBlock { 2; }

# group: Rounds length for 2 digits
code_block_7 = CodeBlock { 2; }
round = Math.Round(number=length, digits=code_block_7)

# group (continued): Gets intersection geometry of these lines with the solids
gt = round > code_block_6
filterByBoolMask_2 = List.FilterByBoolMask(list=flatten_3, mask=gt)
filterByBoolMask_3 = List.FilterByBoolMask(list=round, mask=gt)
watch_2 = Watch(filterByBoolMask_3.in)

# group: Filters lines shorter than 5
number_slider = DoubleSlider(5, range=4..5 step 6)
ge = watch_2 >= number_slider

# group: Shows results in the output
string = StringInput("Revise Room #")
number_2 = Room.Number(room=filterByBoolMask.in)
allTrue = List.AllTrue(list=ge@L2)
filterByBoolMask_4 = List.FilterByBoolMask(list=number_2, mask=allTrue)
count = List.Count(list=filterByBoolMask_4.out)
ofRepeatedItem = List.OfRepeatedItem(item=string, amount=count)
list_create = List.Create(item0=ofRepeatedItem, item1=filterByBoolMask_4.out)
transpose = List.Transpose(lists=list_create)
concat = String.Concat(string0=transpose, lacing=CrossProduct)

# group: View definition
define_view_to_create_lines_to = Views()  # "Define View to create lines to verify issues (it is located at the end of the list, default: ZZ-DESIGN CHECK)"; nothing selected; graph input

# group: Colorizes lines and show them in revit
filterByBoolMask_5 = List.FilterByBoolMask(list=filterByBoolMask_2.in, mask=ge)
boolean_2 = BoolSelector(false)
clean = List.Clean(list=filterByBoolMask_5.out, preserveIndices=boolean_2)
color_palette = ColorPalette({R: 255, G: 0, B: 0, A: 255})
byGeometryColor = Modifiers.GeometryColor.ByGeometryColor(geometry=clean, color=color_palette)
length_2 = Curve.Length(curve=clean)
byCurve = DetailCurve.ByCurve(view=define_view_to_create_lines_to, curve=clean)

# group: Tests "if" values
isEmpty = List.IsEmpty(list=length_2)
code_block_8 = CodeBlock { "No clearance issues"; }
code_block_9 = CodeBlock(y=concat, x=length_2) { y + "| Dimension shorter than 5':" + x; }
if_ = RefactoredIf(test=isEmpty, true=code_block_8, false=code_block_9)

# group: Output
result = Watch(if_)  # graph output

# group: Overrides graphics of line in view (show the line in red)
code_block_10 = CodeBlock { 0; 255; }
byARGB = Color.ByARGB(alpha=code_block_10.out0, red=code_block_10.out1, green=code_block_10.out0, blue=code_block_10.out0)
overrideColorInView = Element.OverrideColorInView(element=byCurve, color=byARGB)
