# Dynamo graph HallwaysLength.dyn (Dynamo 2.16.2.5624)

# group: INPUTS
# note: These groups of nodes will represent information that should be manually or automatically added in order to run the algorithm

# group: DYNAMO GEOMETRIES
# note: These groups will contain nodes that generate geometries to be interpreted by Dynamo

# group: PROCESSES
# note: These groups of nodes will represent actions such as retrieve information, perform intersections, create lists, flatten lists, etc.

# group: OUTPUTS
# note: These groups will include nodes that will show the results generated. These outputs will be also shown in Dynamo Player

# group: INSTRUCTIONS
# note: These nodes will indicate important instruction to adjust elements in the Dynamo Scripts

# group: Gets all rooms in the current document
# note: Hallways Length Calculator
# note: Information:
# Date: Jun-2024
# Developed By: Ingrid Freire
# as a part of her Master's dissertation
# European Master in Building Information Modelling
# Universidade do Minho
categories = Categories("OST_Rooms")
all_elements_of_category = ElementsOfCategory(Category=categories)

# group: Filters out any unplaces rooms
code_block = CodeBlock(rms=all_elements_of_category)
# ---------- code_block.designscript (5 lines) ----------
DSCore.List.Clean(rms.Area>0?
		rms:
		null,
	false
);
# ----------------------------------------

# group: Filters rooms named as hall
name = Room.Name(room=code_block)
room_name_used_for_corridors = StringInput("HALL")  # "Room Name used for corridors/hallways"; graph input
contains = String.Contains(string=name, searchFor=room_name_used_for_corridors)
filterByBoolMask = List.FilterByBoolMask(list=code_block, mask=contains)
watch = Watch(filterByBoolMask.in)

# group: Gets the boundaries of the room
finishBoundary = Room.FinishBoundary(room=watch)
flatten = List.Flatten(list=finishBoundary@L2)

# group: Builds polycurve from the room curves
byJoinedCurves = PolyCurve.ByJoinedCurves(curves=flatten)

ZAxis = Vector.ZAxis()

# group: Gets the tangent vector at the midpoint of each curve
code_block_2 = CodeBlock { 0.5; }
tangentAtParameter = Curve.TangentAtParameter(curve=flatten, param=code_block_2)

# group: Gets the angle from the x axis to the tangent vector using the z axis and the center
XAxis = Vector.XAxis()
ZAxis_2 = Vector.ZAxis()
angleAboutAxis = Vector.AngleAboutAxis(vector=tangentAtParameter, otherVector=XAxis, rotationAxis=ZAxis_2)

# group: Finds the remaining angle after formula
code_block_3 = CodeBlock(a=angleAboutAxis) { Math.Round(a%90,3); }

# group: Groups the curves by their angles of rotation
groupByKey = List.GroupByKey(list=flatten@L2, keys=code_block_3@L2)

# group: Finds the length of each curve, sums the sublists and gets the index with the maximum value, and pulls the angle at that index from the groups
length = Curve.Length(curve=groupByKey.groups)
sum = Math.Sum(values=length)
maximumItem = List.MaximumItem(list=sum)
indexOf = List.IndexOf(list=sum@L2, element=maximumItem@L1)
getItemAtIndex = List.GetItemAtIndex(list=groupByKey.uniqueKeys@L2, index=indexOf@L1)

# group: Rotates each rooms polycurve using Z axis at a point along the curve by the most common angle b y length
pointAtParameter = Curve.PointAtParameter(curve=byJoinedCurves)
rotate = Geometry.Rotate(geometry=byJoinedCurves, origin=pointAtParameter, axis=ZAxis, degrees=getItemAtIndex)

# group: Builds a bounding box around each polycurve, and makes a vector from the minimum point to the maximum point
boundingBox = Geometry.BoundingBox(geometry=rotate@L1)
toCuboid = BoundingBox.ToCuboid(boundingBox=boundingBox)
minPoint = BoundingBox.MinPoint(boundingBox=boundingBox)
maxPoint = BoundingBox.MaxPoint(boundingBox=boundingBox)
byTwoPoints = Vector.ByTwoPoints(start=minPoint, end=maxPoint)

# group: Gets the number from each Hall
number = Room.Number(room=watch)

# group: Gets the x and y components of the vector, these are the width and length
X = Vector.X(vector=byTwoPoints)
Y = Vector.Y(vector=byTwoPoints)

# group: Creates list and transpose the values so we have ordered XY pairs
list_create = List.Create(item0=X, item1=Y)
transpose = List.Transpose(lists=list_create)
code_block_4 = CodeBlock { 2; }
round = Math.Round(number=transpose, digits=code_block_4)

# group: Combines the list
join = List.Join()  # unwired: list0, list1
code_block_5 = CodeBlock(x=number) { "Room number:"+x; }
combine = List.Combine(combineFunction=join, list0=code_block_5, list1=round)

# group: Results
results = Watch(combine)  # graph output

# group: Sets Value to Parameter
string = StringInput("HallwayLength")
maximumItem_2 = List.MaximumItem(list=round)
setParameterByName = Element.SetParameterByName(element=watch, parameterName=string, value=maximumItem_2)
