# Dynamo graph SleepRoomDimensions.dyn (Dynamo 2.16.2.5624)

# note: Sleep Rooms Dimensions Checking
# note: Information:
# Date: Jun-2024
# Developed By: Ingrid Freire
# as a part of her Master's dissertation
# European Master in Building Information Modelling
# Universidade do Minho

# group: INPUTS
# note: These groups of nodes will represent information that should be manually or automatically added in order to run the algorithm

# group: DYNAMO GEOMETRIES
# note: These groups will contain nodes that generate geometries to be interpreted by Dynamo

# group: PROCESSES
# note: These groups of nodes will represent actions such as retrieve information, perform intersections, create lists, flatten lists, etc.

# group: OUTPUTS
# note: These groups will include nodes that will show the results generated. These outputs will be also shown in Dynamo Player

# group: INSTRUCTIONS
# note: These nodes will indicate important instruction to adjust elements in the Dynamo Scripts

# group: Filters Sleep Rooms
categories = Categories("OST_Rooms")
all_elements_of_category = ElementsOfCategory(Category=categories)
name = Room.Name(room=all_elements_of_category)
name_of_sleep_rooms_e_g_sr_sleep = StringInput("SR")  # "Name of Sleep Rooms (e.g: SR, Sleep Room..)"; graph input
contains = String.Contains(string=name, searchFor=name_of_sleep_rooms_e_g_sr_sleep)
filterByBoolMask = List.FilterByBoolMask(list=all_elements_of_category, mask=contains)

code_block = CodeBlock { "Room #"; }

# group: Gets Room number
number = Room.Number(room=filterByBoolMask.in)

addItemToFront = List.AddItemToFront(item=code_block, list=number, lacing=CrossProduct)
concat = String.Concat(string0=addItemToFront)
flatten = List.Flatten(list=concat)

# group: Creates rooms boundary lines
finishBoundary = Room.FinishBoundary(room=filterByBoolMask.in)

# group: Builds polycurve from the room curves
byJoinedCurves = PolyCurve.ByJoinedCurves(curves=finishBoundary)

# group: Gets the tangent vector at the midpoint of each curve
code_block_2 = CodeBlock { 0.5; }
tangentAtParameter = Curve.TangentAtParameter(curve=finishBoundary, param=code_block_2)

# group: Gets the angle from the x axis to the tangent vector using the z axis and the center
XAxis = Vector.XAxis()
ZAxis = Vector.ZAxis()
angleAboutAxis = Vector.AngleAboutAxis(vector=tangentAtParameter, otherVector=XAxis, rotationAxis=ZAxis)

# group: Finds the remaining angle after formula
code_block_3 = CodeBlock(a=angleAboutAxis) { Math.Round(a%90,3); }

# group: Groups the curves by their angles of rotation
groupByKey = List.GroupByKey(list=finishBoundary@L2, keys=code_block_3@L2)

# group: Finds the length of each curve (...)
length = Curve.Length(curve=groupByKey.groups)
sum = Math.Sum(values=length)
maximumItem = List.MaximumItem(list=sum)
indexOf = List.IndexOf(list=sum@L2, element=maximumItem@L1)
getItemAtIndex = List.GetItemAtIndex(list=groupByKey.uniqueKeys@L2, index=indexOf@L1)

# group: Rotate each rooms polycurve using Z axis at a point along the curve by the most common angle b y length
pointAtParameter = Curve.PointAtParameter(curve=byJoinedCurves)
ZAxis_2 = Vector.ZAxis()
rotate = Geometry.Rotate(geometry=byJoinedCurves, origin=pointAtParameter, axis=ZAxis_2, degrees=getItemAtIndex)

# group: Builds a bounding box around each polycurve, and makes a vector from the minimum point to the maximum point
boundingBox = Geometry.BoundingBox(geometry=rotate@L1)
minPoint = BoundingBox.MinPoint(boundingBox=boundingBox)
maxPoint = BoundingBox.MaxPoint(boundingBox=boundingBox)
byTwoPoints = Vector.ByTwoPoints(start=minPoint, end=maxPoint)

# group: gets the x and y components of the vector, these are the width and length
X = Vector.X(vector=byTwoPoints)
Y = Vector.Y(vector=byTwoPoints)

# group: Pass/Fail attributes
code_block_4 = CodeBlock { "Pass"; "Fail"; }

# group: Gets Longitudinal section
watch = Watch(X)
dimension_longitudinal = DoubleInput(8.5)  # graph input
ge = watch >= dimension_longitudinal
if_ = RefactoredIf(test=ge, true=code_block_4.out0, false=code_block_4.out1)
watch_2 = Watch(if_)

# group: Gets Transversal section
watch_3 = Watch(Y)
dimension_transversal = DoubleInput(8.5)  # graph input
ge_2 = watch_3 >= dimension_transversal
if_2 = RefactoredIf(test=ge_2, true=code_block_4.out0, false=code_block_4.out1)
watch_4 = Watch(if_2)
flatten_2 = List.Flatten(list=watch_4)

# group: Sets value to parameter
list_create = List.Create(item0=filterByBoolMask.in)
code_block_5 = CodeBlock { "SleepRoomDims"; }
string = StringInput(";")
join = List.Join()  # unwired: list0, list1, list2
lists = Combine(combineFunction=join, list0=flatten, list1=watch_2, list2=watch_4)
join_2 = String.Join(separator=string, string0=lists)
setParameterByName = Element.SetParameterByName(element=list_create, parameterName=code_block_5, value=join_2)

# group: Gets the number from each Hall
code_block_6 = CodeBlock { "Number"; }
getParameterValueByName = Element.GetParameterValueByName(element=filterByBoolMask.in, parameterName=code_block_6)

# group: Creates list and transpose the values so we have ordered XY pairs
list_create_2 = List.Create(item0=X, item1=Y)
transpose = List.Transpose(lists=list_create_2)
code_block_7 = CodeBlock { 2; }
round = Math.Round(number=transpose, digits=code_block_7)

# group: Combines the list
join_3 = List.Join()  # unwired: list0, list1
combine = List.Combine(combineFunction=join_3, list0=getParameterValueByName, list1=round)

flatten_3 = List.Flatten(list=join_2)

# group: Results
results = Watch(flatten_3)  # graph output
