# Dynamo graph TurnoutTimeCalculator.dyn (Dynamo 2.16.2.5624)
# packages: VASA 0.4.0, archi-lab.net 2024.217.1024, bimorphNodes 5.1.3, Clockwork for Dynamo 2.x 2.6.0

# note: Agent Diameter
# note: Turnout Time Calculator
# note: Information:
# Date: Jun-2024
# Developed By: Ingrid Freire
# as a part of her Master's dissertation
# European Master in Building Information Modelling
# Universidade do Minho

# group: PROCESSES
# note: These groups of nodes will represent actions such as retrieve information, perform intersections, create lists, flatten lists, etc.

# group: INPUTS
# note: These groups of nodes will represent information that should be manually or automatically added in order to run the algorithm

# group: DYNAMO GEOMETRIES
# note: These groups will contain nodes that generate geometries to be interpreted by Dynamo

# group: OUTPUTS
# note: These groups will include nodes that will show the results generated. These outputs will be also shown in Dynamo Player

# group: INSTRUCTIONS
# note: These nodes will indicate important instruction to adjust elements in the Dynamo Scripts

# group: VASA NODES
# note: This color indicates nodes that deal with the voxelization of the model

# group: Creates Solids From Walls
categories = Categories("OST_Walls")
all_elements_of_category = ElementsOfCategory(Category=categories)
solids = Revit.LinkElement.Solids(linkElement=all_elements_of_category)

# group: Creates solids from floors
categories_2 = Categories("OST_Floors")
all_elements_of_category_2 = ElementsOfCategory(Category=categories_2)
flatten = List.Flatten(list=all_elements_of_category_2)
solids_2 = Revit.LinkElement.Solids(linkElement=flatten)

# group: Creates solids from stairs
categories_3 = Categories("OST_Stairs")
all_elements_of_category_3 = ElementsOfCategory(Category=categories_3)
solids_3 = Revit.LinkElement.Solids(linkElement=all_elements_of_category_3)

# group: Creates solids from vertical circulation (slide pole)
categories_4 = Categories("OST_VerticalCirculation")
all_elements_of_category_4 = ElementsOfCategory(Category=categories_4)
solids_4 = Revit.LinkElement.Solids(linkElement=all_elements_of_category_4)

# group: Join the three groups of solids
list_create = List.Create(item0=solids, item1=solids_2, item2=solids_3, item3=solids_4)
flatten_2 = List.Flatten(list=list_create)

boolean = BoolSelector(false)
clean = List.Clean(list=flatten_2, preserveIndices=boolean)

# group (continued): Join the three groups of solids
join_solids = Python(IN[0]=clean)  # IronPython2
# ---------- join_solids.python (18 lines) ----------
import clr
clr.AddReference('ProtoGeometry')
from Autodesk.DesignScript.Geometry import *

solids = IN[0]
OUT = [solids[0]]
solids = solids[1:]

for s in solids:
	i = 0
	unionDone = False
	while i < len(OUT):
		try:
			OUT[i] = OUT[i].Union(s)
			unionDone = True
			break
		except:	i += 1
	if not unionDone: OUT.append(s)
# ----------------------------------------

# group: Creates Voxel Models by Geometry and joins them
code_block_coarse_voxel_width = CodeBlock { 4; }
integer_slider = IntegerSlider(4, range=0..7 step 1)
byGeometry = VASA.Core.VoxelModel.ByGeometry(geometry=join_solids, coarseVoxelWidth=code_block_coarse_voxel_width, finestLOD=integer_slider)
union = VASA.Operations.SolidOperations.Union(voxelModels=byGeometry)

# group: Displays Voxel Model
color_palette = ColorPalette({R: 240, G: 248, B: 255, A: 122})
displayVoxels = VASA.Core.VoxelModel.DisplayVoxels(voxelModel=union, color=color_palette)

# group: Creates Path Model
agent_diameter_defaul_value_9_if = IntegerSlider(3, range=2..12 step 1)  # "Agent Diameter (Defaul value 9, if there are stairs in the model use maximum value 8, if there is a fire pole use maximum 4)"; graph input
agent_height = IntegerSlider(4, range=0..8 step 1)
boolean_2 = BoolSelector(false)
byVoxelModel = VASA.Pathfinding.PathModel.ByVoxelModel(voxelModel=union, agentDiameterOffset=agent_diameter_defaul_value_9_if, agentHeightOffset=agent_height, autoAdjustExtents=boolean_2)

# group: Gets all rooms in the model and their numbers
categories_5 = Categories("OST_Rooms")
all_elements_of_category_5 = ElementsOfCategory(Category=categories_5)
number = Room.Number(room=all_elements_of_category_5)

# group: Gets center of the App Bay
app_bay_room_s_number = StringInput("138")  # graph input
eq = app_bay_room_s_number == number
filterByBoolMask = List.FilterByBoolMask(list=all_elements_of_category_5, mask=eq@L2)
getCentroid = archilab.Revit.Elements.Elements.GetCentroid(element=filterByBoolMask.in)

# group: Generates Distance Field
number_slider = DoubleSlider(-1, range=-1..160 step 0.25)
byPathModelAndSourcePoint = VASA.Pathfinding.DistanceField.ByPathModelAndSourcePoint(pathModel=byVoxelModel, sourcePoint=getCentroid, maxDistance=number_slider)

# group: Gets center of Room #1
room_to_be_checked_1 = StringInput("205")  # graph input
eq_2 = room_to_be_checked_1 == number
filterByBoolMask_2 = List.FilterByBoolMask(list=all_elements_of_category_5, mask=eq_2@L2)
boolean_3 = BoolSelector(false)
getCentroid_2 = archilab.Revit.Elements.Elements.GetCentroid(element=filterByBoolMask_2.in, includeSubComponents=boolean_3)

# group: Gets center of Room #2
room_to_be_checked_2 = StringInput("212")  # graph input
eq_3 = room_to_be_checked_2 == number
filterByBoolMask_3 = List.FilterByBoolMask(list=all_elements_of_category_5, mask=eq_3@L2)
boolean_4 = BoolSelector(false)
getCentroid_3 = archilab.Revit.Elements.Elements.GetCentroid(element=filterByBoolMask_3.in, includeSubComponents=boolean_4)

# group: Sample Points
list_create_2 = List.Create(item0=getCentroid_2, item1=getCentroid_3)
flatten_3 = List.Flatten(list=list_create_2)

# group: Creates path by distance field and Sample Point
byDistanceFieldAndSamplePoint = VASA.Pathfinding.Path.ByDistanceFieldAndSamplePoint(distanceField=byPathModelAndSourcePoint, samplePoint=flatten_3, lacing=Longest)
isValid = VASA.Pathfinding.Path.IsValid(path=byDistanceFieldAndSamplePoint)
filterByBoolMask_4 = List.FilterByBoolMask(list=byDistanceFieldAndSamplePoint, mask=isValid)

# group: Transforms path into polycurve
curveFromSourceToSample = VASA.Pathfinding.Path.CurveFromSourceToSample(path=filterByBoolMask_4.in)

# group: Display path in yellow
color_palette_2 = ColorPalette({R: 220, G: 20, B: 60, A: 255})
byGeometryColor = Modifiers.GeometryColor.ByGeometryColor(geometry=curveFromSourceToSample, color=color_palette_2)

# group: Gets Curve Lengths
length = Curve.Length(curve=curveFromSourceToSample)

# group: Get path length from each room #
deconstruct = List.Deconstruct(list=length@L3)
code_block = CodeBlock(x=deconstruct.first, y=deconstruct.rest) { "Room #1:" + x; "Room #2:" + y; }
list_create_3 = List.Create(item0=code_block.out0, item1=code_block.out1)
flatten_4 = List.Flatten(list=list_create_3)
path_length = Watch(flatten_4)  # graph output

# group: Calculates Average Distance
flatten_5 = List.Flatten(list=length)
average = Math.Average(numbers=flatten_5)
average_distance = Watch(average)

code_block_2 = CodeBlock(Polycurves=curveFromSourceToSample) { Polycurves; }

# group: Creates cuboid from stairs
boundingBox = Revit.LinkElement.BoundingBox(linkElement=all_elements_of_category_3)
toCuboid = BoundingBox.ToCuboid(boundingBox=boundingBox)

# group: Creates cuboid from fire pole
boundingBox_2 = Revit.LinkElement.BoundingBox(linkElement=all_elements_of_category_4)
toCuboid_2 = BoundingBox.ToCuboid(boundingBox=boundingBox_2)

# group: Transforms path into voxel
pathVoxels = VASA.Pathfinding.Path.PathVoxels(path=filterByBoolMask_4.in)
toSolid = VASA.Core.VoxelModel.ToSolid(voxelModel=pathVoxels)

# group: Verifies if path intersect with stairs or pole
join = List.Join(list0=toCuboid, list1=toCuboid_2)
doesIntersect = Geometry.DoesIntersect(geometry=join, other=toSolid, lacing=CrossProduct)
transpose = List.Transpose(lists=doesIntersect)
anyTrue = List.AnyTrue(list=transpose@@L3)
code_block_3 = CodeBlock { "false"; }
replaceNull = archilab.Lists.Lists.ReplaceNull(list=doesIntersect, replacement=code_block_3)
anyTrue_2 = List.AnyTrue(list=replaceNull@@L3)

# group: Polycurve Length that intersects stairs or pole
filterByBoolMask_5 = List.FilterByBoolMask(list=code_block_2@L2, mask=anyTrue)
length_2 = Curve.Length(curve=filterByBoolMask_5.in)

# group: Gets polycurves and flat them
code_block_4 = CodeBlock(Polycurves=curveFromSourceToSample) { Polycurves; }
flatten_6 = List.Flatten(list=code_block_4)

# group: Joins geometries from stairs and pole
join_2 = List.Join(list0=all_elements_of_category_3, list1=all_elements_of_category_4)

# group: Gets height (if the path includes stairs or pole)
filterByBoolMask_6 = List.FilterByBoolMask(list=join_2, mask=anyTrue_2)
categories_6 = Categories("OST_VerticalCirculation")
string_from_object = FromObject(object=categories_6)
code_block_5 = CodeBlock { "Height-GroundToSecond"; }
getCategory = Element.GetCategory(element=filterByBoolMask_6.in)
string_from_object_2 = FromObject(object=getCategory)
categories_7 = Categories("OST_Stairs")
string_from_object_3 = FromObject(object=categories_7)
eq_4 = string_from_object_2 == string_from_object_3
filterByBoolMask_7 = List.FilterByBoolMask(list=filterByBoolMask_6.in, mask=eq_4)
code_block_6 = CodeBlock { "Desired Stair Height"; }
getParameterValueByName = Element.GetParameterValueByName(element=filterByBoolMask_7.in, parameterName=code_block_6)

getCategory_2 = Element.GetCategory(element=filterByBoolMask_6.in)
string_from_object_4 = FromObject(object=getCategory_2)
eq_5 = string_from_object_4 == string_from_object

# group (continued): Gets height (if the path includes stairs or pole)
filterByBoolMask_8 = List.FilterByBoolMask(list=filterByBoolMask_6.in, mask=eq_5)
getParameterValueByName_2 = Element.GetParameterValueByName(element=filterByBoolMask_8.in, parameterName=code_block_5)

# group: Returns cuboid from pole if it intersects with path
isEmpty = List.IsEmpty(list=filterByBoolMask_8.in)
code_block_7 = CodeBlock(CuboidFromPole=toCuboid_2) { CuboidFromPole; }
if_ = RefactoredIf(test=isEmpty, true=filterByBoolMask_8.in, false=code_block_7)

# group: Intersects pole with line from path
filterByBoolMask_9 = List.FilterByBoolMask(list=flatten_6, mask=anyTrue)
curves = PolyCurve.Curves(polyCurve=filterByBoolMask_9.in)
intersectAll = Geometry.IntersectAll(geometry=curves, others=if_)
code_block_8 = CodeBlock { 2; }
flatten_7 = List.Flatten(list=intersectAll@L3, amount=code_block_8)
byJoinedCurves = PolyCurve.ByJoinedCurves(curves=flatten_7)
clear_list = Custom[Clear List](input=byJoinedCurves)  # package archi-lab.net; This node will remove all Null and Empty Lists from any list.
path_at_pole_length = Curve.Length(curve=clear_list)

# group: Average Speeds
average_speed_feet_second = DoubleSlider(4.15, range=1..12 step 0.01)  # "Average Speed Feet/Second (Walkable) - Default Value for = 4.15ft/s"; graph input
time_lost_opening_doors = CodeBlock { 2; }

# group: Gets doors from Model and creates solids
categories_8 = Categories("OST_Doors")
all_elements_of_category_6 = ElementsOfCategory(Category=categories_8)
solids_5 = Revit.LinkElement.Solids(linkElement=all_elements_of_category_6)

# group: Counts number of doors that intersect with the path using stairs/pole
doesIntersect_2 = Geometry.DoesIntersect(geometry=filterByBoolMask_5.in, other=solids_5, lacing=CrossProduct)
anyTrue_3 = List.AnyTrue(list=doesIntersect_2@@L2)
filterByBoolMask_10 = List.FilterByBoolMask(list=all_elements_of_category_6, mask=anyTrue_3@@L2)
count = List.Count(list=filterByBoolMask_10.in@L2)

# group: Calculates Response Time (w/ Pole)
code_block_9 = CodeBlock(PathTotalLength=length_2, PoleLength=path_at_pole_length, PoleVerticalDistance=getParameterValueByName_2) { PathTotalLength; PoleLength; PoleVerticalDistance; }
average_speed_feet_second_pole = DoubleSlider(9.6, range=1..15 step 0.01)  # "Average Speed Feet/Second (Pole - vertical distance) - Default Value = 9.6ft/s"; graph input
formula = Formula("((x-y)/a)+v/d+t*doors", x=code_block_9.PathTotalLength, y=code_block_9.PoleLength@L1, a=average_speed_feet_second, v=code_block_9.PoleVerticalDistance, d=average_speed_feet_second_pole, t=time_lost_opening_doors, doors=count)

watch = Watch(formula)

# group: View name
# note: Paths
select_view_to_create_the_path = Views()  # "Select view to create the path lines (it should be at the end of the list. ZZ-TURNOUT TIME)"; nothing selected; graph input

# group: Creates Detail Curves in View
curves_2 = PolyCurve.Curves(polyCurve=curveFromSourceToSample)
byCurve = Custom[DetailCurve.ByCurve+](curve=curves_2, view=select_view_to_create_the_path)  # package Clockwork for Dynamo 2.x; Creates a detail line based on a given curve. Unlike the OOTB node it can also draw circles.

# group: Polycurve Length that does not intersect stairs
filterByBoolMask_11 = List.FilterByBoolMask(list=code_block_2@L2, mask=anyTrue)
length_3 = Curve.Length(curve=filterByBoolMask_11.out)

# group: Counts number of doors that intersect with the path (walkable) not stairs/pole
doesIntersect_3 = Geometry.DoesIntersect(geometry=filterByBoolMask_11.out, other=solids_5, lacing=CrossProduct)
anyTrue_4 = List.AnyTrue(list=doesIntersect_3@@L2)
filterByBoolMask_12 = List.FilterByBoolMask(list=all_elements_of_category_6, mask=anyTrue_4@@L2)
count_2 = List.Count(list=filterByBoolMask_12.in@L2)

# group: Calculates Response Time (w/o Stairs)
code_block_10 = CodeBlock(PathTotalLength=length_3) { PathTotalLength; }
formula_2 = Formula("x/a+t*doors", x=code_block_10, a=average_speed_feet_second, t=count_2, doors=count)

flatten_8 = List.Flatten(list=formula_2)

# group: Shows output (walkable)
isEmpty_2 = List.IsEmpty(list=flatten_8)
code_block_11 = CodeBlock { "No path without stairs or sliding pole"; }
if_2 = RefactoredIf(test=isEmpty_2, true=code_block_11, false=formula_2)
flatten_9 = List.Flatten(list=if_2)
turnout_time_walkable = Watch(flatten_9)  # graph output

# group: Tests if response time without stairs/pole is equal to zero
eq_6 = turnout_time_walkable == code_block_11
code_block_12 = CodeBlock { 0; }
if_3 = RefactoredIf(test=eq_6, true=code_block_12, false=turnout_time_walkable)

# group: Returns cuboid from stairs if it intersects with path
isEmpty_3 = List.IsEmpty(list=filterByBoolMask_7.in)
code_block_13 = CodeBlock(CuboidFromStairs=toCuboid) { CuboidFromStairs; }
if_4 = RefactoredIf(test=isEmpty_3, true=filterByBoolMask_7.in, false=code_block_13)

# group: Intersects stairs with line from path
filterByBoolMask_13 = List.FilterByBoolMask(list=flatten_6, mask=anyTrue)
curves_3 = PolyCurve.Curves(polyCurve=filterByBoolMask_13.in)
intersectAll_2 = Geometry.IntersectAll(geometry=curves_3, others=if_4)
code_block_14 = CodeBlock { 2; }
flatten_10 = List.Flatten(list=intersectAll_2@L3, amount=code_block_14)
byJoinedCurves_2 = PolyCurve.ByJoinedCurves(curves=flatten_10)
clear_list_2 = Custom[Clear List](input=byJoinedCurves_2)
stairs_length = Curve.Length(curve=clear_list_2)

# group: Calculates Response Time (w/ Stairs)
code_block_15 = CodeBlock(PathTotalLength=length_2, StairsLength=stairs_length, StairsVerticalDistance=getParameterValueByName) { PathTotalLength; StairsLength; StairsVerticalDistance; }
average_speed_feet_second_stairs = DoubleSlider(2.05, range=0.5..10 step 0.01)  # "Average Speed Feet/Second (Stairs - vertical distance) - Default Value = 2.05ft/s"; graph input
formula_3 = Formula("((x-y)/a)+v/d+t*doors", x=code_block_15.PathTotalLength, y=code_block_15.StairsLength@L1, a=average_speed_feet_second, v=code_block_15.StairsVerticalDistance, d=average_speed_feet_second_stairs, t=time_lost_opening_doors, doors=count)

flatten_11 = List.Flatten(list=formula_3)

# group: Shows output (stairs)
isEmpty_4 = List.IsEmpty(list=flatten_11)
code_block_16 = CodeBlock { "No path intersecting stairs"; }
if_5 = RefactoredIf(test=isEmpty_4, true=code_block_16, false=formula_3)
flatten_12 = List.Flatten(list=if_5)
turnout_time_includes_stairs = Watch(flatten_12)  # graph output

# group: Tests if response time including stairs is equal to zero
eq_7 = turnout_time_includes_stairs == code_block_16
code_block_17 = CodeBlock { 0; }
if_6 = RefactoredIf(test=eq_7, true=code_block_17, false=formula_3)

flatten_13 = List.Flatten(list=formula)

# group: Shows output (firepole)
isEmpty_5 = List.IsEmpty(list=flatten_13)
code_block_18 = CodeBlock { "No path intersecting firepole"; }
if_7 = RefactoredIf(test=isEmpty_5, true=code_block_18, false=formula)
flatten_14 = List.Flatten(list=if_7)
turnout_time_includes_firepole = Watch(flatten_14)  # graph output

# group: Tests if response time including pole is equal to zero
eq_8 = turnout_time_includes_firepole == code_block_18
code_block_19 = CodeBlock { 0; }
if_8 = RefactoredIf(test=eq_8, true=code_block_19, false=formula)

# group: Average Response Time
list_create_4 = List.Create(item0=if_3, item1=if_6, item2=if_8)
flatten_15 = List.Flatten(list=list_create_4)
ne = flatten_15 != code_block_17
filterByBoolMask_14 = List.FilterByBoolMask(list=flatten_15, mask=ne)
average_2 = Math.Average(numbers=filterByBoolMask_14.in)
average_turnout_time = Watch(average_2)  # graph output
