# Dynamo graph zCleanLines.dyn (Dynamo 2.16.2.5624)
# packages: archi-lab.net 2024.217.1024, Clockwork for Dynamo 2.x 2.6.0

# group: Gets elements in Active View
all_elements_in_active_view = ElementsInView()

# group: Filter by category (lines)
getCategory = Element.GetCategory(element=all_elements_in_active_view)
string_from_object = FromObject(object=getCategory)
code_block = CodeBlock { "Lines"; }
eq = string_from_object == code_block
filterByBoolMask = List.FilterByBoolMask(list=all_elements_in_active_view, mask=eq)

# group: Filter by detail lines
string_from_object_2 = FromObject(object=filterByBoolMask.in)
string = StringInput("DetailCurve")
eq_2 = string_from_object_2 == string
filterByBoolMask_2 = List.FilterByBoolMask(list=filterByBoolMask.in, mask=eq_2)

# group: Deletes them
delete = archilab.Revit.Elements.Elements.Delete(element=filterByBoolMask_2.in)

# group: Collects Path of Travel Lines
categories = Categories("OST_PathOfTravelLines")
all_elements_of_category = ElementsOfCategory(Category=categories)
activeViewFromCurrentDocument = Custom[Document.ActiveViewFromCurrentDocument]()  # package Clockwork for Dynamo 2.x; Gets the active view of the current document

# group: Checks if they are visible in current view
isVisible = archilab.Revit.Elements.Elements.IsVisible(element=all_elements_of_category, view=activeViewFromCurrentDocument)
filterByBoolMask_3 = List.FilterByBoolMask(list=all_elements_of_category, mask=isVisible)

# group: Deletes them
delete_2 = archilab.Revit.Elements.Elements.Delete(element=filterByBoolMask_3.in)
