# Dynamo graph zCleanOverrides.dyn (Dynamo 2.16.2.5624)
# packages: Clockwork for Dynamo 2.x 2.6.0

# group: Resets Element Overrides in Active View
all_elements_in_active_view = ElementsInView()
current = Document.Current()
activeView = Document.ActiveView(document=current)
resetElementOverrides = Custom[View.ResetElementOverrides](element=all_elements_in_active_view, view=activeView)  # package Clockwork for Dynamo 2.x; Resets all overrides for an element in a given view
