# Dynamo graph zCleanParameters.dyn (Dynamo 2.16.2.5624)

# group: Doors
categories = Categories("OST_Doors")
all_elements_of_category = ElementsOfCategory(Category=categories)
code_block = CodeBlock { "FireRatingCheck"; "DoorClearance"; "DoorFireRating"; "Doors_To"; "Doors_From"; "DoorLocation"; "ExitDirection"; }
string = StringInput(" ")
setParameterByName = Element.SetParameterByName(element=all_elements_of_category, parameterName=code_block.out0, value=string)
setParameterByName_2 = Element.SetParameterByName(element=all_elements_of_category, parameterName=code_block.out1, value=string)
setParameterByName_3 = Element.SetParameterByName(element=all_elements_of_category, parameterName=code_block.out2, value=string)
setParameterByName_4 = Element.SetParameterByName(element=all_elements_of_category, parameterName=code_block.out3, value=string)
setParameterByName_5 = Element.SetParameterByName(element=all_elements_of_category, parameterName=code_block.out4, value=string)
setParameterByName_6 = Element.SetParameterByName(element=all_elements_of_category, parameterName=code_block.out5, value=string)
setParameterByName_7 = Element.SetParameterByName(element=all_elements_of_category, parameterName=code_block.out6, value=string)

# group: Walls
categories_2 = Categories("OST_Walls")
all_elements_of_category_2 = ElementsOfCategory(Category=categories_2)
code_block_2 = CodeBlock { "FireRatingCheck"; "FireRatedWallIsAttached"; }
string_2 = StringInput(" ")
setParameterByName_8 = Element.SetParameterByName(element=all_elements_of_category_2, parameterName=code_block_2.out0, value=string_2)
setParameterByName_9 = Element.SetParameterByName(element=all_elements_of_category_2, parameterName=code_block_2.out1, value=string_2)

# group: Rooms
categories_3 = Categories("OST_Rooms")
all_elements_of_category_3 = ElementsOfCategory(Category=categories_3)
code_block_3 = CodeBlock { "SleepRoomDims"; }
string_3 = StringInput(" ")
setParameterByName_10 = Element.SetParameterByName(element=all_elements_of_category_3, parameterName=code_block_3, value=string_3)
